# Grasshopper definition manis_demo.gh (Grasshopper 1.0.7)
# plug-ins: Topologic Connections, Bifocals

brep = Brep([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])
build = PlateModelBuilder(Breps=brep)  # -> Model, Breps, Sequence, Log
neighbours = NeighboursIDs(Model=build.Model)  # -> Ids, Pairs, Neighbours
contact = ContactZones(Model=build.Model)  # -> Zones, Planes
topology = TopologicConnections(Model=build.Model)  # -> Types, Strings
geo = Geometry(contact.Zones)
panel = Panel(neighbours.Ids)
panel_2 = Panel(topology.Types)
pln = Plane(contact.Planes)
panel_3 = Panel(neighbours.Pairs)
panel_4 = Panel(topology.Strings)
branch = TreeBranch(Tree=neighbours.Neighbours, Path=Slider(2, range=0..10), MaintainPaths=True)

sequence = DisplaySequence(breps=brep)

brep_2 = Brep([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])
build_2 = PlateModelBuilder(Breps=brep_2)  # -> Model, Breps, Sequence, Log
contours = PlateContours(Model=build_2.Model)  # -> Top_contour, Mid_contour, Bottom_contour
planes = PlatePlanes(Model=build_2.Model)  # -> Top_plane, Mid_plane, Bottom_plane
holes = PlateHoles(Model=build_2.Model)  # -> Top_holes, Bottom_holes
faces = PlateFaces(Model=build_2.Model)  # -> Top_face, Bottom_face
thickness = PlateThickness(Model=build_2.Model)
panel_5 = Panel(thickness)

# ----
# MODEL PROPERTIES AND TOPOLOGY
sequence_2 = DisplaySequence(breps=brep_2)

brep_3 = Brep([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])
sequence_3 = DisplaySequence(breps=brep_3)
build_3 = PlateModelBuilder(Breps=brep_3)  # -> Model, Breps, Sequence, Log
tenon = AddTenonJoint(
    Model=build_3.Model,
    Tenon_number=Slider(3, range=0..10),
    Tenon_length=Slider(0, range=0..3),
    Tenon_width=Slider(1.4, range=0.1..5),
    Tenon_spacing=Slider(1, range=0..10),
    Tenon_shift=Slider(0, range=-1.5..1.5))  # -> Model, Joints_positives, Joints_negatives, Joints_keys

brep_4 = Brep([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])
sequence_4 = DisplaySequence(breps=brep_4)
build_4 = PlateModelBuilder(Breps=brep_4)  # -> Model, Breps, Sequence, Log
half_lap = AddHalfLapJoint(
    Model=build_4.Model,
    Proportion=Slider(0.5, range=0.1..0.9),
    Tolerance=Slider(0, range=0..1),
    Min_angle=Slider(79, range=0..100),
    Straight_height=Slider(0.8, range=0..1),
    Fillet_height=Slider(0.6, range=0..1),
    Segments=Slider(10, range=0..10))  # -> Model, Joints_positives, Joints_negatives, Joints_keys

brep_5 = Brep([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])
sequence_5 = DisplaySequence(breps=brep_5)
build_5 = PlateModelBuilder(Breps=brep_5)  # -> Model, Breps, Sequence, Log
sunrise = AddSunriseDovetailJoint(
    Model=build_5.Model,
    Tenon_number=Slider(5, range=0..10),
    Tenon_width=Slider(0.5, range=0.1..2),
    Tenon_spacing=Slider(0.5, range=0.1..2),
    Tenon_shift=Slider(0, range=0..1),
    Spread_angle=Slider(45, range=0..45),
    Parallel_tenons=Toggle(False))  # -> Model, Joints_positives, Joints_negatives, Joints_keys

brep_6 = Brep([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])
# PLATE JOINTS
build_6 = PlateModelBuilder(Breps=brep_6)  # -> Model, Breps, Sequence, Log
geo_2 = Geometry(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)
dowel = AddDowelJoint(
    Model=build_6.Model,
    Dowel_number=Slider(3, range=1..10),
    Dowel_radius=Slider(0.1, range=0.1..0.5),
    Dowel_tolerance=Slider(0, range=0..0.1),
    Dowel_retreat_1=Slider(0, range=0..1),
    Dowel_retreat_2=Slider(0, range=0..1),
    Circle_radius=Slider(1, range=1..2),
    Circle_rotation=Slider(0, range=0..360),
    Dowel_angle_1=Slider(0, range=-180..180),
    Dowel_angle_2=Slider(0, range=0..100),
    Parallel=Toggle(True))  # -> Model, Joints_positives, Joints_negatives, Joints_keys

brep_7 = Brep([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])
sequence_6 = DisplaySequence(breps=brep_7)
build_7 = PlateModelBuilder(Breps=brep_7)  # -> Model, Breps, Sequence, Log
finger = AddFingerJoint(
    Model=build_7.Model,
    Finger_number_1=Slider(3, range=0..10),
    Finger_length_1=Slider(0, range=0..3),
    Finger_width_1=Slider(1, range=0..1),
    Finger_number_2=Slider(3, range=0..10),
    Finger_length_2=Slider(0, range=0..3),
    Finger_width_2=Slider(1, range=0..1),
    Finger_spacing=Slider(0.36, range=0..2),
    Finger_shift=Slider(0, range=0..1),
    Mirror=Toggle(True))  # -> Model, Joints_positives, Joints_negatives, Joints_keys

sequence_7 = DisplaySequence(breps=brep_6)

constraint = CreateConstraint(Alpha=Slider(180, range=45..180), Beta=Slider(0, range=0..100))  # -> Constraint, Boundaries
constraints = MergeConstraints(FS=constraint.Constraint)
brep_8 = Brep([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])
build_8 = PlateModelBuilder(Breps=brep_8, Constraints=constraints)  # -> Model, Breps, Sequence, Log
insertion = InsertionSpace(Model=build_8.Model)  # -> Spheres, Grouped
contact_2 = ContactZones(Model=build_8.Model)  # -> Zones, Planes
sequence_8 = DisplaySequence(breps=build_8.Breps)
number_slider = Slider(2, range=0..10)
anim = AnimateSequence(Model=build_8.Model, Step=Slider(0, range=0..1), Retreat=Slider(10, range=0..10))  # -> Breps, Status
scale = Scale(Geometry=insertion.Spheres, Center=contact_2.Planes, Factor=Slider(1, range=0..10))  # -> Geometry, Transform
branch_2 = TreeBranch(Tree=insertion.Grouped, Path=number_slider, MaintainPaths=True)
branch_3 = TreeBranch(Tree=scale.Geometry, Path=number_slider, MaintainPaths=True)
item = ListItem(List=branch_2, Index=0, Wrap=True)  # -> Item, Item1
geo_3 = Geometry(item.Item)
geo_4 = Geometry(item.Item1)

brep_9 = Brep([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])
sequence_9 = DisplaySequence(breps=brep_9)
build_9 = PlateModelBuilder(Breps=brep_9)  # -> Model, Breps, Sequence, Log
number_slider_2 = Slider(1, range=0..1)
finger_2 = AddFingerJoint(Model=build_9.Model, Finger_number_1=number_slider_2, Finger_number_2=number_slider_2)  # -> Model, Joints_positives, Joints_negatives, Joints_keys
merge = MergeJointsWithPlates(Model=finger_2.Model)  # -> Model, Breps
anim_2 = AnimateSequence(Model=merge.Model, Step=Slider(0, range=0..1), Retreat=Slider(10, range=0..10))  # -> Breps, Status

# ----
# ASSEMBLY SEQUENCE AND INSERTION CONSTRAINTS
brep_10 = Brep([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])
build_10 = PlateModelBuilder(Breps=brep_10, Sequence="[2,1,0]")  # -> Model, Breps, Sequence, Log
panel_6 = Panel(build_10.Sequence)
sequence_10 = DisplaySequence(breps=build_10.Breps)
anim_3 = AnimateSequence(Model=build_10.Model, Step=Slider(0, range=0..1), Retreat=Slider(10, range=0..10))  # -> Breps, Status

brep_11 = Brep([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])
sequence_11 = DisplaySequence(breps=brep_11)
build_11 = PlateModelBuilder(Breps=brep_11, Sequence="[[0,1,2],[3,4,5]]")  # -> Model, Breps, Sequence, Log
tenon_2 = AddTenonJoint(
    Model=build_11.Model,
    Tenon_number=Slider(2, range=0..10),
    Tenon_width=Slider(0.8, range=0..1),
    Tenon_spacing=Slider(3, range=0..10),
    Tenon_shift=Slider(1.2, range=0..10))  # -> Model, Joints_positives, Joints_negatives, Joints_keys
sunrise_2 = AddSunriseDovetailJoint(
    Model=tenon_2.Model,
    Tenon_number=Slider(4, range=0..10),
    Tenon_width=Slider(0.5, range=0..1),
    Tenon_spacing=Slider(1.5, range=0..10),
    Spread_angle=Slider(30, range=0..100))  # -> Model, Joints_positives, Joints_negatives, Joints_keys
merge_2 = MergeJointsWithPlates(Run=Toggle(True), Model=sunrise_2.Model)  # -> Model, Breps
deci = Decimals(number=Slider(0, range=0..3))  # -> integer_part, decimals
modules = GetModules(Model=merge_2.Model, Module_id=deci.integer_part)  # -> Module, Sequence, Step, Breps
anim_4 = AnimateSequence(Model=modules.Module, Step=deci.decimals, Retreat=Slider(10, range=0..10))  # -> Breps, Status
assembly = AssemblyVectors(Module=modules.Module)  # -> Assembly, Relatives, Spaces
panel_7 = Panel(assembly.Relatives)

brep_12 = Brep([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])
sequence_12 = DisplaySequence(breps=brep_12)
build_12 = PlateModelBuilder(Breps=brep_12, Sequence="[[0,1,2],[3,4,5]]")  # -> Model, Breps, Sequence, Log
# MODULAR ASSEMBLIES
number_slider_3 = Slider(2, range=0..10)
tenon_3 = AddTenonJoint(
    Model=build_12.Model,
    Tenon_number=number_slider_3,
    Tenon_width=Slider(1, range=0..1),
    Tenon_spacing=Slider(2, range=0.1..2))  # -> Model, Joints_positives, Joints_negatives, Joints_keys
merge_3 = MergeJointsWithPlates(Run=Toggle(True), Model=tenon_3.Model)  # -> Model, Breps
deci_2 = Decimals(number=Slider(0, range=0..3))  # -> integer_part, decimals
modules_2 = GetModules(Model=merge_3.Model, Module_id=deci_2.integer_part)  # -> Module, Sequence, Step, Breps
anim_5 = AnimateSequence(Model=modules_2.Module, Step=deci_2.decimals, Retreat=Slider(10, range=0..10))  # -> Breps, Status

brep_13 = Brep([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])
build_13 = PlateModelBuilder(Breps=brep_13)  # -> Model, Breps, Sequence, Log
sequence_13 = DisplaySequence(breps=brep_13)
tenon_4 = AddTenonJoint(Model=build_13.Model, Tenon_width=Slider(2, range=0..10))  # -> Model, Joints_positives, Joints_negatives, Joints_keys
# DESIGN-TO-FABRICATION
half_lap_2 = AddHalfLapJoint(Model=tenon_4.Model)  # -> Model, Joints_positives, Joints_negatives, Joints_keys
panel_8 = Panel("""(0,1)
(0,3)""")
sunrise_3 = AddSunriseDovetailJoint(Model=half_lap_2.Model, Plates_pairs=panel_8)  # -> Model, Joints_positives, Joints_negatives, Joints_keys
sunrise_4 = AddSunriseDovetailJoint(Model=sunrise_3.Model, Plates_pairs="(4,5)", Tenon_number=Slider(4, range=0..10), Spread_angle=Slider(30, range=0..100))  # -> Model, Joints_positives, Joints_negatives, Joints_keys
merge_4 = MergeJointsWithPlates(Model=sunrise_4.Model)  # -> Model, Breps
sqgrid = Square(
    Plane=PlaneXY(95, 19.06747828, 0),
    Size=Slider(24, range=0..100),
    ExtentX=Slider(2, range=0..10),
    ExtentY=Slider(3, range=0..10))  # -> Cells, Points
geo_5 = Geometry(flatten(sqgrid.Cells))
area = Area(Geometry=geo_5)  # -> Area, Centroid
array = ExplodeInArray(Model=merge_4.Model, Custom=area.Centroid)  # -> Model, Breps
anim_6 = AnimateSequence(Model=merge_4.Model, Step=Slider(0, range=0..1), Retreat=Slider(10, range=0..10))  # -> Breps, Status
number_slider_4 = Slider(0.1, range=0..0.1)
toggle = BooleanToggle(True)
toolpath = ToolpathGenerator(
    Model=array.Model,
    Contour_tool_radius=number_slider_4,
    Holes_tool_radius=number_slider_4,
    Notch=toggle,
    Cylinder=toggle,
    Tbone=Toggle(False))  # -> Model, Top_milling_contour, Bottom_milling_contour, Top_milling_holes, Bottom_milling_holes
joints = PlateJoints(Model=toolpath.Model)  # -> Joints_positives, Joints_negatives, Joints_keys
merge_5 = MergeJointsWithPlates(Run=Toggle(False), Model=toolpath.Model, Bool_tol=Slider(0.01, range=0..0.01), Merge_tol=Slider(0.1, range=0..0.1))  # -> Model, Breps
sequence_14 = DisplaySequence(breps=merge_5.Breps)

# ==== cluster Decimals: split a number into its integer and decimal part.
number = ClusterInput()  # number
python = GhPythonScript(x=number)  # -> out, a, b
# ---------- python: Python ----------
__author__ = "rogeau"
__version__ = "2020.11.02"

import rhinoscriptsyntax as rs


st= str(x).split(".")
a = int(st[0])
b = float("0."+st[1])
# ---------- end python ----------
integer_part = ClusterOutput(python.a)  # int
decimals = ClusterOutput(python.b)  # dec

# ==== cluster DisplaySequence: Display a colorful assembly sequence.
breps = ClusterInput()  # Plate as Brep

# ---- group: Brep
dom = ConstructDomain(DomainStart=Slider(0, range=0..1), DomainEnd=Slider(0.3, range=0..1))
lng = ListLength(List=breps)
range = Range(Domain=dom, Steps=lng)
hsl = ColourHSL(Alpha=Slider(0.26, range=0..1), Hue=range, Saturation=Slider(1, range=0..1), Luminance=Slider(0.6, range=0..1))
preview = CustomPreview(Geometry=breps, Material=hsl)

# ---- group: Text
area = Area(Geometry=breps)  # -> Area, Centroid
index = ItemIndex(List=breps, Item=breps)
pl = ConstructPlane(Origin=area.Centroid, XAxis=Vector(1, 0, 0), YAxis=Vector(0, 0, 1))
sqrt = SquareRoot(Value=area.Area)
division = Division(A=sqrt, B=10)
tag = TextTag3D(Location=pl, Text=index, Size=division, Colour=ColourSwatch(SwatchColor=RGB(0, 0, 0)), Justification=5)
